# Grasshopper definition GeometrySorterComponent_GH#.gh (Grasshopper 1.0.7)

# ----
# ParaStorm LAB
# Computational Design && Visual Programming
# Parametric Design Concept
# ------------------------------------------------------------------
# YouTube / ParaStorm LAB
# Facebook Group / ParaStorm LAB
# ParaStorm LAB
# input a list of ramdom type of geometries it will sort its in branches each >>
# GH# component
geometrysorter = CSharpScript()  # -> out, GList; inputs Geometries: list of GeometryBase
# ---------- geometrysorter: C# usings ----------
using System.Linq;
# ---------- geometrysorter: C# ----------
    // An Algorithm Written by Parastorm lab - maanfordesign@gmail.com
    // this component can you use it if you have a random geopetries collection and can not be able to collect each
    // in a specific branches so try to do one step without more !!
    //░▒█▀▀█░█▀▀░▄▀▀▄░█▀▄▀█░█▀▀░▀█▀░█▀▀▄░█░░█░▒█▀▀▀█░▄▀▀▄░█▀▀▄░▀█▀░█▀▀░█▀▀▄░▒█▀▀▄░█░░▄▀▀▄░█▀▄░█░▄
    //░▒█░▄▄░█▀▀░█░░█░█░▀░█░█▀▀░░█░░█▄▄▀░█▄▄█░░▀▀▀▄▄░█░░█░█▄▄▀░░█░░█▀▀░█▄▄▀░▒█▀▀▄░█░░█░░█░█░░░█▀▄
    //░▒█▄▄▀░▀▀▀░░▀▀░░▀░░▒▀░▀▀▀░░▀░░▀░▀▀░▄▄▄▀░▒█▄▄▄█░░▀▀░░▀░▀▀░░▀░░▀▀▀░▀░▀▀░▒█▄▄█░▀▀░░▀▀░░▀▀▀░▀░▀

    if(Geometries.Count == 0 || Geometries == null)
    {
      Component.AddRuntimeMessage(GH_RuntimeMessageLevel.Warning, "No Data To Prosses");

    }else
    {
      // Set the output an calling the function
      GList = GeometriesSorter(Geometries);
    }
# ---------- geometrysorter: C# additional code ----------
  // a function that take a list of geometries then divide it to datatree
  // and finally put each type in specific branch

  public DataTree<GeometryBase> GeometriesSorter(List<GeometryBase> Geometries)
  {
    // Create a dictionary to hold sorted geometries
    var sortedGeometries = new Dictionary<string, List<GeometryBase>>();

    // Iterate through the list of geometries
    foreach(var geometry in Geometries)
    {
      // Get the type of the geometry
      string type = geometry.GetType().Name;

      // If the type is not yet in the dictionary, add it
      if(!sortedGeometries.ContainsKey(type))
      {
        sortedGeometries[type] = new List<GeometryBase>();
      }

      // Add the geometry to the correct list based on its type
      sortedGeometries[type].Add(geometry);

    }

    // Convert the dictionary to a tree structure for output
    DataTree<GeometryBase> tree = new DataTree<GeometryBase>();
    int i = 0;
    foreach(var keyValuePair in sortedGeometries)
    {
      // Create a path for each type
      GH_Path path = new GH_Path(i);
      // Add the geometries to the tree under this path
      tree.AddRange(keyValuePair.Value, path);
      i++;
    }
    return tree;
  }
# ---------- end geometrysorter ----------
